# Grasshopper definition monoceros_practice.gh (Grasshopper 1.0.7)
# plug-ins: Bifocals, Monoceros

# ----
# Horizontal T Pipe
geo = Geometry([<brep referenced from the Rhino model> x29])
geo_2 = Geometry([<brep referenced from the Rhino model> x29])
geo_3 = Geometry([<brep referenced from the Rhino model> x29])
geo_4 = Geometry([<brep referenced from the Rhino model> x29])
mesh = Mesh(geo)
mesh_2 = Mesh(geo_2)
mesh_3 = Mesh(geo_3)
mesh_4 = Mesh(geo_4)

# ----
# Vertical T Pipe
geo_5 = Geometry([<brep referenced from the Rhino model> x29])
geo_6 = Geometry([<brep referenced from the Rhino model> x29])
geo_7 = Geometry([<brep referenced from the Rhino model> x29])
geo_8 = Geometry([<brep referenced from the Rhino model> x29])
mesh_5 = Mesh(geo_5)
mesh_6 = Mesh(geo_6)
mesh_7 = Mesh(geo_7)
mesh_8 = Mesh(geo_8)

# ----
# Vertical L Pipe
geo_9 = Geometry([<brep referenced from the Rhino model> x19])
geo_10 = Geometry([<brep referenced from the Rhino model> x19])
geo_11 = Geometry([<brep referenced from the Rhino model> x19])
geo_12 = Geometry([<brep referenced from the Rhino model> x19])
mesh_9 = Mesh(geo_9)
mesh_10 = Mesh(geo_10)
mesh_11 = Mesh(geo_11)
mesh_12 = Mesh(geo_12)

# ----
# Horizontal L Pipe
geo_13 = Geometry([<brep referenced from the Rhino model> x19])
geo_14 = Geometry([<brep referenced from the Rhino model> x19])
geo_15 = Geometry([<brep referenced from the Rhino model> x19])
geo_16 = Geometry([<brep referenced from the Rhino model> x19])
mesh_13 = Mesh(geo_13)
mesh_14 = Mesh(geo_14)
mesh_15 = Mesh(geo_15)
mesh_16 = Mesh(geo_16)

# ----
# Cross Pipe
geo_17 = Geometry([<brep referenced from the Rhino model> x45])
geo_18 = Geometry([<brep referenced from the Rhino model> x45])
geo_19 = Geometry([<brep referenced from the Rhino model> x45])
mesh_17 = Mesh(geo_17)
mesh_18 = Mesh(geo_18)
mesh_19 = Mesh(geo_19)

# ----
# Liner Pipe
geo_20 = Geometry([<brep referenced from the Rhino model> x19])
geo_21 = Geometry([<brep referenced from the Rhino model> x19])
geo_22 = Geometry([<brep referenced from the Rhino model> x19])
mesh_20 = Mesh(geo_20)
mesh_21 = Mesh(geo_21)
mesh_22 = Mesh(geo_22)

number_slider = Slider(2, range=0..10)
neg = Negative(Value=number_slider)
series = Series(Start=0, Step=neg, Count=Slider(4, range=0..10))
series_2 = Series(Start=number_slider, Step=number_slider, Count=Slider(6, range=0..10))  # -> graft(Series)
number_slider_2 = Slider(0.5, range=0..1)
pt = ConstructPoint(XCoordinate=series, YCoordinate=series_2, ZCoordinate=0)
box = CenterBox(Base=pt, X=number_slider_2, Y=number_slider_2, Z=number_slider_2)
debrep = DeconstructBrep(Brep=box)  # -> Faces, Edges, Vertices
bang = ExplodeTree(Data=box)  # -> Branch0, Branch1, Branch2, Branch3, Branch4, Branch5
area = Area(Geometry=debrep.Faces)  # -> Area, Centroid
cull_i = CullIndex(List=bang.Branch1, Indices="-1", Wrap=True)
cull_i_2 = CullIndex(List=bang.Branch0, Indices="-1", Wrap=True)
entwine = Entwine(
    Branch00=cull_i_2,
    Branch01=cull_i,
    Branch02=bang.Branch2,
    Branch03=bang.Branch3,
    Branch04=bang.Branch4,
    Branch05=bang.Branch5,
    FlattenInputs=True)
volume = Volume(Geometry=entwine)  # -> Volume, Centroid
flatten = FlattenTree(Tree=volume.Centroid, Path="{0}")  # -> graft(Tree)

entwine_2 = Entwine(
    Branch00=mesh_20,
    Branch01=mesh_21,
    Branch02=mesh_22,
    Branch03=mesh_17,
    Branch04=mesh_18,
    Branch05=mesh_19,
    Branch06=mesh_13,
    Branch07=mesh_14,
    Branch08=mesh_16,
    Branch09=mesh_15,
    Branch010=mesh_9,
    Branch011=mesh_10,
    Branch012=mesh_12,
    Branch013=mesh_11,
    Branch014=mesh_5,
    Branch015=mesh_6,
    Branch016=mesh_8,
    Branch017=mesh_7,
    Branch018=mesh,
    Branch019=mesh_2,
    Branch020=mesh_4,
    Branch021=mesh_3,
    FlattenInputs=True)  # -> simplify(Result)
geo_23 = Geometry(entwine_2)

group = Group(Objects=geo_23)  # -> flatten(Group)
lng = ListLength(List=group)
series_3 = Series(Start=0, Step=1, Count=lng)
concat = Concatenate(FragmentA="module", FragmentB=series_3)  # -> simplify(graft(Result))
constmodule = ConstructModule(
    ModuleName=concat,
    ModulePartPoints=flatten,
    Geometry=geo_23,
    BasePlane=PlaneXY(0, 0, 0),
    ModulePartDiagonal=Vector(1, 1, 1))

number_slider_3 = Slider(3, range=0..10)
number_slider_4 = Slider(7, range=0..100)
pt_2 = ConstructPoint(XCoordinate=number_slider_3, YCoordinate=number_slider_3, ZCoordinate=0)
series_4 = Series(Start=0, Step=1, Count=Slider(7, range=0..10))  # -> graft(Series)
sqgrid = Square(Plane=pt_2, Size=1, ExtentX=number_slider_4, ExtentY=number_slider_4)  # -> Cells, flatten(Points)
Z = UnitZ(Factor=series_4)
move = Move(Geometry=sqgrid.Points, Motion=Z)  # -> Geometry, Transform
slotall = ConstructSlotWithAllModulesAllowed(SlotPoint=move.Geometry, BasePlane=PlaneXY(0, 0, 0), GridSlotDiagonal=Vector(1, 1, 1))

moduleempty = ConstructEmptyModule(BasePlane=PlaneXY(0, 0, 0), ModulePartDiagonal=Vector(1, 1, 1))  # -> Module, Rules
merge = Merge(Data1=moduleempty.Module, Data2=constmodule)
flatten_2 = FlattenTree(Tree=merge, Path="{0}")

pt_3 = Point([<point referenced from the Rhino model> x14])
pt_4 = Point([<point referenced from the Rhino model> x24])
pt_5 = Point([<point referenced from the Rhino model> x20])
ruletyppt = TypedRuleFromPoint(Modules=flatten_2, PointTag=pt_3, ConnectorType="vertical-joint01")
ruletyppt_2 = TypedRuleFromPoint(Modules=flatten_2, PointTag=pt_4, ConnectorType="Horizontal-joint01")
ruletyppt_3 = TypedRuleFromPoint(Modules=flatten_2, PointTag=pt_5, ConnectorType="Horizontal-joint02")
merge_2 = Merge(Data1=ruletyppt, Data2=ruletyppt_2, Data3=ruletyppt_3)  # -> flatten(Result)

ruleindiffunused = IndifferentRulesForUnusedConnectors(Module=flatten_2, Rules=merge_2)

merge_3 = Merge(Data1=ruleindiffunused, Data2=ruletyppt, Data3=ruletyppt_2, Data4=ruletyppt_3)  # -> flatten(Result)

wfc = MonocerosWFCSolver(
    Slots=flatten(slotall),
    Modules=flatten(flatten_2),
    Rules=flatten(merge_3),
    RandomSeed=Slider(99, range=0..100),
    MaxAttempts=10,
    MaxObservations=2147483647,
    MaxTime=0,
    UseShannonEntropy=False)  # -> Out, Slots, Deterministic, Contradictory, Seed, Attempts, Observations
materialize = MaterializeSlots(Modules=flatten_2, Slots=wfc.Slots)  # -> Geometry, Transform
